# Dynamo graph Auto_Categories_Off_for_CableTray Views.dyn (Dynamo 2.6.1.8786)

views = Views("Top Of Waffle")
categories = Categories("OST_ConduitFitting")
byProperties = Revit.Filter.OverrideGraphicSettings.ByProperties()
boolean = BoolSelector(true)
setCategoryOverrides = View.SetCategoryOverrides(view=views, category=categories, overrides=byProperties, hide=boolean)
categories_2 = Categories("OST_Conduit")
setCategoryOverrides_2 = View.SetCategoryOverrides(view=views, category=categories_2, overrides=byProperties, hide=boolean)
categories_3 = Categories("OST_FlexPipeCurves")
setCategoryOverrides_3 = View.SetCategoryOverrides(view=views, category=categories_3, overrides=byProperties, hide=boolean)
categories_4 = Categories("OST_PipeFitting")
setCategoryOverrides_4 = View.SetCategoryOverrides(view=views, category=categories_4, overrides=byProperties, hide=boolean)
categories_5 = Categories("OST_PipeCurves")
setCategoryOverrides_5 = View.SetCategoryOverrides(view=views, category=categories_5, overrides=byProperties, hide=boolean)
categories_6 = Categories("OST_ElectricalEquipment")
setCategoryOverrides_6 = View.SetCategoryOverrides(view=views, category=categories_6, overrides=byProperties, hide=boolean)
categories_7 = Categories("OST_ElectricalFixtures")
setCategoryOverrides_7 = View.SetCategoryOverrides(view=views, category=categories_7, overrides=byProperties, hide=boolean)
