# Dynamo graph Auto_Categories_Off_for_Conduit Views.dyn "Auto_Categories_Hide_for_Conduit Views" (Dynamo 2.6.1.8786)

views = Views("Top Of Waffle")
categories = Categories("OST_CableTray")
byProperties = Revit.Filter.OverrideGraphicSettings.ByProperties()
boolean = BoolSelector(true)
setCategoryOverrides = View.SetCategoryOverrides(view=views, category=categories, overrides=byProperties, hide=boolean)
categories_2 = Categories("OST_CableTrayFitting")
setCategoryOverrides_2 = View.SetCategoryOverrides(view=views, category=categories_2, overrides=byProperties, hide=boolean)
categories_3 = Categories("OST_DuctFitting")
setCategoryOverrides_3 = View.SetCategoryOverrides(view=views, category=categories_3, overrides=byProperties, hide=boolean)
categories_4 = Categories("OST_DuctCurves")
setCategoryOverrides_4 = View.SetCategoryOverrides(view=views, category=categories_4, overrides=byProperties, hide=boolean)
