# Dynamo graph Generic_Model_Off_From_Model.dyn (Dynamo 2.6.2.15705)
# packages: Crumple 2021.9.24

views = Custom[© Views]()  # package Crumple; Returns all views in a document. Excludes system views, templates, legends and schedule instances.
categories = Categories("OST_GenericModel")
byProperties = Revit.Filter.OverrideGraphicSettings.ByProperties()
boolean = BoolSelector(true)  # graph input
setCategoryOverrides = View.SetCategoryOverrides(view=views, category=categories, overrides=byProperties, hide=boolean)
